# Grasshopper definition test.gh (Grasshopper 1.0.7)
# Copyright: 2021
# plug-ins: ImageClipboard, PdfPlus, LadybugGrasshopper

c_script = CSharpScript()  # -> out, A
# ---------- c_script: C# usings ----------
using System.Reflection;
# ---------- c_script: C# ----------
    var modules = Grasshopper.Instances.ComponentServer.Libraries;
    foreach (GH_AssemblyInfo item in modules)
    {
      //      //Print(item.Name);
      //      if(item.Name == "BitmapComponent")
      //      {
      //        Assembly bmpAssembly = item.Assembly;
      //
      //        Object o = bmpAssembly.CreateInstance("GrasshopperBitmapParam", false,
      //          BindingFlags.ExactBinding,
      //          null, new Object[] { 2 }, null, null);
      //
      //        A = o;
      //      }

      Print(item.Name);
      if(item.Name == "PdfPlus")
      {
        Assembly bmpAssembly = item.Assembly;
        foreach(var type in bmpAssembly.DefinedTypes)
        {
          Print("___" + type.Name);
        }

        Object o = bmpAssembly.CreateInstance("GrasshopperBitmapParam", false,
          BindingFlags.ExactBinding,
          null, new Object[] { 2 }, null, null);

        A = o;
      }
    }
# ---------- end c_script ----------
panel = Panel(c_script.A)
panel_2 = Panel(c_script.out)
image = ClipboardImage(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)
rec = Rectangle({Plane=PlaneXY(271.0242099, 439.1959905, 0), Size=Domain2(u=-247.7847266..247.7847266, v=-143.7365946..143.7365946)})
img_frame = ImageFrame(Image=image, Boundary=rec)
page_metric = AddPageMetric(Type=4, Orientation=2)  # -> Page, Boundary
content = SetContents(Page=page_metric.Page, Content=img_frame)
falsestart = LBFalseStartToggle(False)
doc = AddDocument(Pages=content, PageLayout=0)
save_doc = SaveDocument(Document=doc, Directory="C:\Ladybug\", FileName="00_testX", Save=falsestart)
